# Grasshopper definition 001_1 HYPR.gh (Grasshopper 1.0.7)
# plug-ins: Bifocals

# ---- group: RH_IN:SCALE
radius = Slider(5, range=0..10)

# ----
value_list = ValueList({"Square": 4, "Triangle": 3, "Hexagon": 6, "Octagon": 8}, selected="Square")
division = Division(A=radius, B="10")
polygon = Polygon(Plane=PlaneXY(0, 0, 0), Radius=radius, Segments=value_list, FilletRadius=0)  # -> Polygon, Length
circle = Circle(Plane=PlaneXY(0, 0, 0), Radius=radius)
series = Series(Start="0", Step=division, Count="10")
negative = Negative(Value=series)
offset_curve = OffsetCurve(Curve=circle, Distance=negative, Plane=PlaneXY(0, 0, 0), Corners=1)
# Flatten list item to separate everything
list_item = ListItem(List=offset_curve, Index=0, Wrap=True)  # -> flatten(Item)
panel = Panel(list_item)
cull_index = CullIndex(List=list_item, Indices="0", Wrap=True)
# Splits List into 2 parts, alternate by default
dispatch = Dispatch(List=list_item, DispatchPattern=[True, False])  # -> ListA, ListB
dispatch_2 = Dispatch(List=cull_index, DispatchPattern=[True, False])  # -> ListA, ListB
ring_i = Slider(0, range=0..4)
ring_g = Slider(1, range=0..4)
ring_e = Slider(2, range=0..4)
ring_c = Slider(3, range=0..4)
ring_a = Slider(4, range=0..4)
ring_b = Slider(4, range=0..4)
ring_d = Slider(3, range=0..4)
ring_f = Slider(2, range=0..4)
ring_j = Slider(0, range=0..4)
ring_h = Slider(1, range=0..4)
boundary_surfaces = BoundarySurfaces(Edges=[dispatch.ListB, dispatch.ListA])
boundary_surfaces_2 = BoundarySurfaces(Edges=[dispatch_2.ListA, dispatch_2.ListB])
thickness = Slider(0.1, range=0..1)
panel_2 = Panel(boundary_surfaces)
panel_3 = Panel(boundary_surfaces_2)
list_item_2 = ListItem(List=boundary_surfaces_2, Index=ring_i, Wrap=True)
list_item_3 = ListItem(List=boundary_surfaces_2, Index=ring_g, Wrap=True)
list_item_4 = ListItem(List=boundary_surfaces_2, Index=ring_e, Wrap=True)
list_item_5 = ListItem(List=boundary_surfaces_2, Index=ring_c, Wrap=True)
list_item_6 = ListItem(List=boundary_surfaces_2, Index=ring_a, Wrap=True)
thickness_2 = Slider(0.1, range=0..1)
list_item_7 = ListItem(List=boundary_surfaces, Index=ring_d, Wrap=True)
list_item_8 = ListItem(List=boundary_surfaces, Index=ring_f, Wrap=True)
list_item_9 = ListItem(List=boundary_surfaces, Index=ring_b, Wrap=True)
list_item_10 = ListItem(List=boundary_surfaces, Index=ring_h, Wrap=True)
list_item_11 = ListItem(List=boundary_surfaces, Index=ring_j, Wrap=True)
unit_z = UnitZ(Factor=thickness_2)
unit_z_2 = UnitZ(Factor=thickness)
negative_2 = Negative(Value=unit_z_2)
negative_3 = Negative(Value=unit_z)

# ---- group: RH_IN:SPIN
rotate_ring_z = Slider(184, range=0..360)

# ----
extrude = Extrude(Base=list_item_9, Direction=[negative_2, unit_z_2])
extrude_2 = Extrude(Base=list_item_7, Direction=[negative_2, unit_z_2])
extrude_3 = Extrude(Base=list_item_8, Direction=[negative_2, unit_z_2])
extrude_4 = Extrude(Base=list_item_10, Direction=[negative_2, unit_z_2])
extrude_5 = Extrude(Base=list_item_11, Direction=[negative_2, unit_z_2])
extrude_6 = Extrude(Base=list_item_2, Direction=[negative_3, unit_z])
extrude_7 = Extrude(Base=list_item_3, Direction=[negative_3, unit_z])
extrude_8 = Extrude(Base=list_item_4, Direction=[negative_3, unit_z])
extrude_9 = Extrude(Base=list_item_5, Direction=[negative_3, unit_z])
extrude_10 = Extrude(Base=list_item_6, Direction=[negative_3, unit_z])
sine = Sine(Value=rotate_ring_z)
cosine = Cosine(Value="60")
tangent = Tangent(Value=[rotate_ring_z, "90"])
yz_plane = YZPlane(Origin=Point(0, 0, 0))
xz_plane = XZPlane(Origin=Point(0, 0, 0))
xz_plane_2 = XZPlane(Origin=Point(0, 0, 0))
xz_plane_3 = XZPlane(Origin=Point(0, 0, 0))
xz_plane_4 = XZPlane(Origin=Point(0, 0, 0))
yz_plane_2 = YZPlane(Origin=Point(0, 0, 0))
yz_plane_3 = YZPlane(Origin=Point(0, 0, 0))
yz_plane_4 = YZPlane(Origin=Point(0, 0, 0))
addition = Addition(A=rotate_ring_z, B=sine)
addition_2 = Addition(A=rotate_ring_z, B=cosine)
addition_3 = Addition(A=rotate_ring_z, B=tangent)
negative_4 = Negative(Value=addition)
negative_5 = Negative(Value=addition_2)
negative_6 = Negative(Value=addition_3)
negative_7 = Negative(Value=rotate_ring_z)
rotate = Rotate(Geometry=extrude, Angle=rotate_ring_z, Plane=yz_plane)  # -> Geometry, Transform
rotate_2 = Rotate(Geometry=extrude_2, Angle=addition, Plane=yz_plane_4)  # -> Geometry, Transform
rotate_3 = Rotate(Geometry=extrude_3, Angle=addition_2, Plane=yz_plane_2)  # -> Geometry, Transform
rotate_4 = Rotate(Geometry=extrude_4, Angle=addition_3, Plane=yz_plane_3)  # -> Geometry, Transform
rotate_5 = Rotate(Geometry=extrude_6, Angle=negative_7, Plane=xz_plane)  # -> Geometry, Transform
rotate_6 = Rotate(Geometry=extrude_7, Angle=negative_4, Plane=xz_plane_2)  # -> Geometry, Transform
rotate_7 = Rotate(Geometry=extrude_8, Angle=negative_5, Plane=xz_plane_3)  # -> Geometry, Transform
rotate_8 = Rotate(Geometry=extrude_9, Angle=negative_6, Plane=xz_plane_4)  # -> Geometry, Transform
mesh = Mesh(rotate_5.Geometry)
mesh_2 = Mesh(rotate.Geometry)
mesh_3 = Mesh(rotate_2.Geometry)
mesh_4 = Mesh(rotate_3.Geometry)
mesh_5 = Mesh(rotate_4.Geometry)
mesh_6 = Mesh(extrude_5)
mesh_7 = Mesh(rotate_8.Geometry)
mesh_8 = Mesh(extrude_10)
mesh_9 = Mesh(rotate_6.Geometry)
mesh_10 = Mesh(rotate_7.Geometry)

# ---- group: RH_OUT:GEOMETRY
mesh_11 = Mesh([mesh_9, mesh, mesh_10, mesh_7, mesh_8, mesh_6, mesh_5, mesh_4, mesh_3, mesh_2])
