# Grasshopper definition POLY.gh (Grasshopper 1.0.7)

# ---- group: RH_IN:radius
radius = Slider(10, range=5..20)

# ---- group: RH_IN:segments
segments = Slider(6, range=3..20)

# ----
polygon = Polygon(Plane=PlaneXY(0, 0, 0), Radius=radius, Segments=segments, FilletRadius=0)  # -> Polygon, Length
panel = Panel(polygon.Polygon)
surface = Surface(polygon.Polygon)
panel_2 = Panel(surface)

# ---- group: RH_IN:height
height = Slider(10, range=5..20)

# ----
unit_z = UnitZ(Factor=height)
extrude_point = ExtrudePoint(Base=surface, Point=unit_z)

# ---- group: RH_OUT:mesh
mesh = Mesh(extrude_point)
